# Dynamo graph testFile.dyn (Dynamo 3.3.0.6316)

code_block = CodeBlock { 5; 4; }
byWidthLength = Rectangle.ByWidthLength(width=code_block.out0, length=code_block.out1)
code_block_2 = CodeBlock { Plane.ByOriginNormal(Point.ByCoordinates(0,0,0),Vector.ByCoordinates(0,0,1)); }
number_slider = DoubleSlider(0, range=0..100 step 0.1)
rotate = Geometry.Rotate(geometry=byWidthLength, basePlane=code_block_2, degrees=number_slider)
code_block_3 = CodeBlock { 3; }
extrude = Curve.Extrude(curve=rotate, distance=code_block_3)
code_block_4 = CodeBlock(x=extrude) { x.Faces; }
surfaceGeometry = Face.SurfaceGeometry(face=code_block_4)
code_block_5 = CodeBlock { [0,1,2,3]; }
getItemAtIndex = List.GetItemAtIndex(list=surfaceGeometry, index=code_block_5)
code_block_6 = CodeBlock { 0.5; }
pointAtParameter = Surface.PointAtParameter(surface=surfaceGeometry, u=code_block_6, v=code_block_6)
normalAtParameter = Surface.NormalAtParameter(surface=surfaceGeometry, u=code_block_6, v=code_block_6)
byOriginNormal = Plane.ByOriginNormal(origin=pointAtParameter, normal=normalAtParameter)
getItemAtIndex_2 = List.GetItemAtIndex(list=byOriginNormal, index=code_block_5)
code_block_7 = CodeBlock { 0.5; }
scale = Geometry.Scale(geometry=getItemAtIndex, plane=getItemAtIndex_2, xamount=code_block_7, yamount=code_block_7, zamount=code_block_7)
perimeterCurves = Surface.PerimeterCurves(surface=scale)
code_block_8 = CodeBlock {  }
code_block_9 = CodeBlock { "TestModel"; }
difference = Surface.Difference(surface=surfaceGeometry, others=scale)
code_block_10 = CodeBlock(x=difference) { x.Faces; }
flatten = List.Flatten(list=code_block_10)
code_block_11 = CodeBlock { "W1"; "Lightweight Concrete"; }
code_block_12 = CodeBlock { "Concrete"; 0.144; 110; }
fluxMaterial = DynaFlux.Build.FluxMaterial.FluxMaterial(name=code_block_12.out0, thermalConductivity=code_block_12.out1, thickness=code_block_12.out2)
fluxConstruction = DynaFlux.Build.FluxConstruction.FluxConstruction(id=code_block_11.out0, name=code_block_11.out1, materials=fluxMaterial)
create = DynaFlux.Build.FluxSurface.Create(face=flatten, construction=fluxConstruction)
code_block_13 = CodeBlock(x=scale) { x.Faces; }
flatten_2 = List.Flatten(list=code_block_13)
code_block_14 = CodeBlock()
# ---------- code_block_14.designscript (4 lines) ----------
"F1";
"Double Pane Glazing";
0.3;
// SC;
# ----------------------------------------
code_block_15 = CodeBlock { "Glass"; 1.053; 8; 6; }
fluxMaterial_2 = DynaFlux.Build.FluxMaterial.FluxMaterial(name=code_block_15.out0, thermalConductivity=code_block_15.out1, thickness=code_block_15.out2)
code_block_16 = CodeBlock { "Air Gap"; 0.11; 5; }
fluxMaterial_3 = DynaFlux.Build.FluxMaterial.FluxMaterial(name=code_block_16.out0, thermalConductivity=code_block_16.out1, thickness=code_block_16.out2)
fluxMaterial_4 = DynaFlux.Build.FluxMaterial.FluxMaterial(name=code_block_15.out0, thermalConductivity=code_block_15.out1, thickness=code_block_15.out3)
list_create = List.Create(item0=fluxMaterial_2, item1=fluxMaterial_3, item2=fluxMaterial_4)
code_block_17 = CodeBlock { 0.36; }
fluxConstruction_2 = DynaFlux.Build.FluxConstruction.FluxConstruction(id=code_block_14.out0, name=code_block_14.out1, materials=list_create, sc1=code_block_14.out2, sc2=code_block_17)
create_2 = DynaFlux.Build.FluxSurface.Create(face=flatten_2, construction=fluxConstruction_2)
list_create_2 = List.Create(item0=create, item1=create_2)
flatten_3 = List.Flatten(list=list_create_2)
fluxModel = DynaFlux.Build.FluxModel.FluxModel(projectName=code_block_9, surfaces=flatten_3)
facadeOrientations = DynaFlux.Build.FluxModel.FacadeOrientations(fluxModel=fluxModel)
name = DynaFlux.Build.FluxOrientation.Name(fluxOrientation=facadeOrientations)
normal = DynaFlux.Build.FluxOrientation.Normal(fluxOrientation=facadeOrientations)
correctionFactor = DynaFlux.Build.FluxOrientation.CorrectionFactor(fluxOrientation=facadeOrientations)
angle = DynaFlux.Build.FluxOrientation.Angle(fluxOrientation=facadeOrientations)
surfaces = DynaFlux.Build.FluxModel.Surfaces(fluxModel=fluxModel)
projectName = DynaFlux.Build.FluxModel.ProjectName(fluxModel=fluxModel)
constructions = DynaFlux.Build.FluxModel.Constructions(fluxModel=fluxModel)
name_2 = DynaFlux.Build.FluxConstruction.Name(fluxConstruction=constructions)
uvalue = DynaFlux.Build.FluxConstruction.Uvalue(fluxConstruction=constructions)
type = DynaFlux.Build.FluxConstruction.Type(fluxConstruction=constructions)
materials = DynaFlux.Build.FluxConstruction.Materials(fluxConstruction=constructions)
name_3 = DynaFlux.Build.FluxMaterial.Name(fluxMaterial=materials)
thermalConductivity = DynaFlux.Build.FluxMaterial.ThermalConductivity(fluxMaterial=materials)
thickness = DynaFlux.Build.FluxMaterial.Thickness(fluxMaterial=materials)
id = DynaFlux.Build.FluxConstruction.Id(fluxConstruction=constructions)
fluxModelResult = DynaFlux.Result.FluxModelResult.FluxModelResult(model=fluxModel)
averageETTV = DynaFlux.Result.FluxModelResult.AverageETTV(fluxModelResult=fluxModelResult)
fluxModelResult_2 = DynaFlux.Result.FluxModelResult.FluxModelResult(model=fluxModel)
resultPerOrientation = DynaFlux.Result.FluxModelResult.ResultPerOrientation(fluxModelResult=fluxModelResult_2)
fenestrationConductionHeatGain = DynaFlux.Result.FluxOrientationResult.FenestrationConductionHeatGain(fluxOrientationResult=resultPerOrientation)
fenestrationRadiationHeatGain = DynaFlux.Result.FluxOrientationResult.FenestrationRadiationHeatGain(fluxOrientationResult=resultPerOrientation)
opaqueConductionHeatGain = DynaFlux.Result.FluxOrientationResult.OpaqueConductionHeatGain(fluxOrientationResult=resultPerOrientation)
calculateTotalETTV = DynaFlux.Result.FluxOrientationResult.CalculateTotalETTV(fluxOrientationResult=resultPerOrientation)
calculateTotalETTV_2 = DynaFlux.Result.FluxOrientationResult.CalculateTotalETTV(fluxOrientationResult=resultPerOrientation)
sc2 = DynaFlux.Build.FluxConstruction.Sc2(fluxConstruction=constructions)
sc1 = DynaFlux.Build.FluxConstruction.Sc1(fluxConstruction=constructions)
scTot = DynaFlux.Build.FluxConstruction.ScTot(fluxConstruction=constructions)
type_2 = DynaFlux.Build.FluxConstruction.Type(fluxConstruction=constructions)
